# Dynamo graph WD_XUAT CAD VA PDF_script.dyn (Dynamo 3.0.3.7597)
# author: Tai Em
# Done

python_script = Python()  # CPython3; unwired: IN[0]
# ---------- python_script.python (244 lines) ----------
import sys
import os
import json
import clr

clr.AddReference('RevitAPI')
from Autodesk.Revit.DB import *

clr.AddReference('RevitServices')
from RevitServices.Persistence import DocumentManager
from RevitServices.Transactions import TransactionManager

clr.AddReference('System.Windows.Forms')
clr.AddReference('System.Drawing')
import System
from System.Windows.Forms import (
    Form, Label, TextBox, Button, ComboBox, CheckBox,
    DialogResult, FormStartPosition, FormBorderStyle, ComboBoxStyle,
    MessageBox, MessageBoxButtons, MessageBoxIcon
)
from System.Drawing import Size, Point, Font, FontStyle, Color, ContentAlignment

doc = DocumentManager.Instance.CurrentDBDocument

# Quản lý cấu hình
CONFIG_PATH = os.path.join(os.environ.get('TEMP', 'C:\\Temp'), 'multi_exporter_config.json')

def load_config():
    cfg = {
        "cad_prefix": "DUAN", "pdf_name": "BAN_VE_PDF",
        "cad_path": "C:\\ExportCAD", "pdf_path": "C:\\ExportPDF",
        "export_cad": True, "export_pdf": True, "combine_pdf": True
    }
    if os.path.exists(CONFIG_PATH):
        try:
            with open(CONFIG_PATH, 'r') as f:
                cfg.update(json.load(f))
        except: pass
    return cfg

def save_config(cad_p, pdf_n, cad_path, pdf_path, cad, pdf, comb):
    try:
        with open(CONFIG_PATH, 'w') as f:
            json.dump({
                "cad_prefix": cad_p, "pdf_name": pdf_n,
                "cad_path": cad_path, "pdf_path": pdf_path,
                "export_cad": cad, "export_pdf": pdf, "combine_pdf": comb
            }, f)
    except: pass

# Lấy dữ liệu Sheet Set & Export Setups từ Revit
sheet_sets = FilteredElementCollector(doc).OfClass(ViewSheetSet).ToElements()
set_dict = {s.Name: s for s in sheet_sets} if sheet_sets else {}

dwg_setups = FilteredElementCollector(doc).OfClass(ExportDWGSettings).ToElements()
dwg_setup_dict = {s.Name: s for s in dwg_setups} if dwg_setups else {}

try:
    pdf_setups = FilteredElementCollector(doc).OfClass(ExportPDFSettings).ToElements()
    pdf_setup_dict = {s.Name: s for s in pdf_setups} if pdf_setups else {}
except: pdf_setup_dict = {}

# Khởi tạo Form UI
saved_cfg = load_config()
form = Form()
form.Text = "Sheet Set Exporter (CAD & PDF)"
form.Size = Size(680, 640)
form.StartPosition = FormStartPosition.CenterScreen
form.FormBorderStyle = FormBorderStyle.FixedDialog
form.MaximizeBox = False
form.MinimizeBox = False

def create_label(text, x, y, w, h):
    lbl = Label()
    lbl.Text = text
    lbl.Location = Point(x, y)
    lbl.Size = Size(w, h)
    return lbl

# 1. Chọn Sheet Set
form.Controls.Add(create_label("1. Chọn Sheet Set cần xuất:", 20, 20, 620, 20))
cb_set = ComboBox()
cb_set.Location = Point(20, 45)
cb_set.Size = Size(620, 25)
cb_set.DropDownStyle = ComboBoxStyle.DropDownList
for k in sorted(set_dict.keys()): cb_set.Items.Add(k)
if cb_set.Items.Count > 0: cb_set.SelectedIndex = 0
form.Controls.Add(cb_set)

# 2. Định dạng xuất
form.Controls.Add(create_label("Định dạng xuất:", 20, 90, 120, 22))

chk_cad = CheckBox()
chk_cad.Text = "Xuất CAD (.dwg)"
chk_cad.Location = Point(155, 88)
chk_cad.Size = Size(145, 24)
chk_cad.Checked = saved_cfg.get("export_cad", True)
form.Controls.Add(chk_cad)

chk_pdf = CheckBox()
chk_pdf.Text = "Xuất PDF (.pdf)"
chk_pdf.Location = Point(305, 88)
chk_pdf.Size = Size(140, 24)
chk_pdf.Checked = saved_cfg.get("export_pdf", True)
form.Controls.Add(chk_pdf)

chk_combine = CheckBox()
chk_combine.Text = "Gộp chung 1 file PDF"
chk_combine.Location = Point(450, 88)
chk_combine.Size = Size(190, 24)
chk_combine.Checked = saved_cfg.get("combine_pdf", True)
form.Controls.Add(chk_combine)

# 3. Setup DWG & PDF
form.Controls.Add(create_label("2. Chọn DWG Export Setup:", 20, 135, 300, 20))
cb_dwg = ComboBox()
cb_dwg.Location = Point(20, 160)
cb_dwg.Size = Size(300, 25)
cb_dwg.DropDownStyle = ComboBoxStyle.DropDownList
for k in dwg_setup_dict.keys(): cb_dwg.Items.Add(k)
if dwg_setup_dict: cb_dwg.SelectedIndex = 0
form.Controls.Add(cb_dwg)

form.Controls.Add(create_label("3. Chọn PDF Export Setup:", 340, 135, 300, 20))
cb_pdf = ComboBox()
cb_pdf.Location = Point(340, 160)
cb_pdf.Size = Size(300, 25)
cb_pdf.DropDownStyle = ComboBoxStyle.DropDownList
cb_pdf.Items.Add("<in-session>")
for k in pdf_setup_dict.keys(): cb_pdf.Items.Add(k)
cb_pdf.SelectedIndex = 0
form.Controls.Add(cb_pdf)

# 4. Tiền tố & Tên file
form.Controls.Add(create_label("4. Tiền tố file CAD:", 20, 205, 620, 20))
txt_cad_prefix = TextBox()
txt_cad_prefix.Location = Point(20, 230)
txt_cad_prefix.Size = Size(620, 25)
txt_cad_prefix.Text = saved_cfg.get("cad_prefix", "DUAN")
form.Controls.Add(txt_cad_prefix)

form.Controls.Add(create_label("5. Tên file PDF:", 20, 270, 620, 20))
txt_pdf_name = TextBox()
txt_pdf_name.Location = Point(20, 295)
txt_pdf_name.Size = Size(620, 25)
txt_pdf_name.Text = saved_cfg.get("pdf_name", "TSG-WON")
form.Controls.Add(txt_pdf_name)

# 5. Thư mục lưu
form.Controls.Add(create_label("6. Thư mục lưu file CAD:", 20, 335, 620, 20))
txt_cad_path = TextBox()
txt_cad_path.Location = Point(20, 360)
txt_cad_path.Size = Size(620, 25)
txt_cad_path.Text = saved_cfg.get("cad_path", "C:\\ExportCAD")
form.Controls.Add(txt_cad_path)

form.Controls.Add(create_label("7. Thư mục lưu file PDF:", 20, 400, 620, 20))
txt_pdf_path = TextBox()
txt_pdf_path.Location = Point(20, 425)
txt_pdf_path.Size = Size(620, 25)
txt_pdf_path.Text = saved_cfg.get("pdf_path", "C:\\ExportPDF")
form.Controls.Add(txt_pdf_path)

# Nút Run
btn_run = Button()
btn_run.Text = "XUẤT BẢN VẼ (EXPORT)"
btn_run.Location = Point(220, 480)
btn_run.Size = Size(220, 45)
btn_run.DialogResult = DialogResult.OK
btn_run.BackColor = Color.LightSkyBlue
form.Controls.Add(btn_run)

# Tác giả
lbl_author = Label()
lbl_author.Text = "By: Nguyen Anh Tai"
lbl_author.Font = Font("Segoe UI", 8.5, FontStyle.Italic)
lbl_author.ForeColor = Color.DimGray
lbl_author.Location = Point(490, 550)
lbl_author.Size = Size(150, 20)
lbl_author.TextAlign = ContentAlignment.MiddleRight
form.Controls.Add(lbl_author)

# Thực thi Export
if form.ShowDialog() == DialogResult.OK:
    cad_prefix = txt_cad_prefix.Text
    pdf_name = txt_pdf_name.Text
    cad_folder = txt_cad_path.Text
    pdf_folder = txt_pdf_path.Text
    
    save_config(cad_prefix, pdf_name, cad_folder, pdf_folder, chk_cad.Checked, chk_pdf.Checked, chk_combine.Checked)

    matched_sheets = []
    selected_set = str(cb_set.SelectedItem) if cb_set.SelectedItem else ""
    
    if selected_set in set_dict:
        for v in set_dict[selected_set].Views:
            if isinstance(v, ViewSheet): 
                matched_sheets.append(v)

    dwg_opt = dwg_setup_dict[cb_dwg.SelectedItem].GetDWGExportOptions() if cb_dwg.SelectedItem in dwg_setup_dict else DWGExportOptions()
    dwg_opt.MergedViews = True

    cad_cnt, pdf_cnt = 0, 0
    TransactionManager.Instance.EnsureInTransaction(doc)

    # Xuất CAD
    if chk_cad.Checked and matched_sheets:
        if not os.path.exists(cad_folder): os.makedirs(cad_folder)
        for s in matched_sheets:
            fn = "{}-{}-{}".format(cad_prefix, str(s.SheetNumber).replace("/", "-"), str(s.Name).replace("/", "-"))
            if doc.Export(cad_folder, fn, System.Collections.Generic.List[ElementId]([s.Id]), dwg_opt):
                cad_cnt += 1

    # Xuất PDF
    if chk_pdf.Checked and matched_sheets:
        if not os.path.exists(pdf_folder): os.makedirs(pdf_folder)
        
        # Xử lý lấy PDFExportOptions đúng chuẩn Revit API
        selected_pdf_setup = str(cb_pdf.SelectedItem)
        if selected_pdf_setup in pdf_setup_dict:
            pdf_opt = pdf_setup_dict[selected_pdf_setup].GetOptions()
        else:
            pdf_opt = PDFExportOptions()
            
        pdf_opt.Combine = chk_combine.Checked
        
        if chk_combine.Checked:
            pdf_opt.FileName = pdf_name
            doc.Export(pdf_folder, System.Collections.Generic.List[ElementId]([s.Id for s in matched_sheets]), pdf_opt)
            pdf_cnt = len(matched_sheets)
        else:
            for s in matched_sheets:
                pdf_opt.FileName = "{}-{}-{}".format(pdf_name, str(s.SheetNumber).replace("/", "-"), str(s.Name).replace("/", "-"))
                doc.Export(pdf_folder, System.Collections.Generic.List[ElementId]([s.Id]), pdf_opt)
                pdf_cnt += 1

    TransactionManager.Instance.TransactionTaskDone()
    
    msg = "ĐÃ XUẤT BẢN VẼ HOÀN TẤT!\n\n- File CAD xuất được: {}\n- Bản PDF xuất được: {}".format(cad_cnt, pdf_cnt)
    MessageBox.Show(msg, "Thông báo xuất file", MessageBoxButtons.OK, MessageBoxIcon.Information)
    
    OUT = msg
else:
    OUT = "Đã hủy."
# ----------------------------------------
